# Dynamo graph Revit Sheet Set (ViewSet) from Project Browser Selection.dyn (Dynamo 2.0.3.8810)

# group: Select Sheets or Views
# note: Select sheets or views in the Revit Project Browser before running.

# group: ViewSet Name
code_block = CodeBlock { "ViewSet Name"; }

# note: Revit Sheet Set (ViewSet) from Project Browser Selection
# Version 0.1
# Coded by Andrew King
# https://andrewkingme.com
# 2018-11-15 Version 0.1
# Hello World
python_script = Python()  # unwired: IN[0]
# ---------- python_script.python (36 lines) ----------
# Python Code for Dynamo
# Output Selected Elements
# Coded by Andrew King
# https://andrewkingme.com

import clr
clr.AddReference('ProtoGeometry')
from Autodesk.DesignScript.Geometry import *

#Import RevitNodes
clr.AddReference("RevitNodes")
import Revit
clr.ImportExtensions(Revit.Elements)

# Import RevitAPI
clr.AddReference('RevitAPI')
import Autodesk
from Autodesk.Revit.DB import *

# Import DocumentManager and TransactionManager
clr.AddReference('RevitServices')
import RevitServices
from RevitServices.Persistence import DocumentManager
from RevitServices.Transactions import TransactionManager

output = []

# Get ElementIds of Revit selection.
selection = DocumentManager.Instance.CurrentUIApplication.ActiveUIDocument.Selection.GetElementIds()

# Convert ElementIds to Revit elements.
for s in selection:
	output.append(DocumentManager.Instance.CurrentDBDocument.GetElement(s).ToDSType(True))

#Assign your output to the OUT variable.
OUT = output
# ----------------------------------------
watch = Watch(python_script)
python_script_2 = Python(IN[0]=code_block, IN[1]=watch)
# ---------- python_script_2.python (43 lines) ----------
# Python Code for Dynamo
# Create ViewSet from Input
# Coded by Andrew King
# https://andrewkingme.com

import clr
clr.AddReference('ProtoGeometry')
from Autodesk.DesignScript.Geometry import *

# Import RevitAPI
clr.AddReference('RevitAPI')
import Autodesk
from Autodesk.Revit.DB import *

# Import DocumentManager and TransactionManager
clr.AddReference('RevitServices')
import RevitServices
from RevitServices.Persistence import DocumentManager
from RevitServices.Transactions import TransactionManager

# Assign input to the IN variables.
viewSetName = IN[0]
views = UnwrapElement(IN[1])

# Create empty ViewSet.
viewSet = ViewSet()

# Add incoming views/sheets to the ViewSet.
for v in views:
	viewSet.Insert(v)

# Activate the PrintManager.
printManager = DocumentManager.Instance.CurrentDBDocument.PrintManager
printManager.PrintRange = PrintRange.Select

# Save the ViewSet.
viewSheetSetting = printManager.ViewSheetSetting
viewSheetSetting.CurrentViewSheetSet.Views = viewSet
viewSheetSetting.SaveAs(viewSetName)
output = "ViewSet '" + viewSetName + "' created."

#Assign your output to the OUT variable.
OUT = output
# ----------------------------------------
watch_2 = Watch(python_script_2)
